% Simulink data dictionary IF.sldd

ia = Simulink.Signal(StorageClass="ExportedGlobal", DataType="single")
ic = Simulink.Signal(StorageClass="ExportedGlobal", DataType="single")
ib = Simulink.Signal(StorageClass="ExportedGlobal", DataType="single")
ialpha = Simulink.Signal(StorageClass="ExportedGlobal", DataType="single")
ibeta = Simulink.Signal(StorageClass="ExportedGlobal", DataType="single")
id = Simulink.Signal(StorageClass="ExportedGlobal", DataType="single")
iq = Simulink.Signal(StorageClass="ExportedGlobal", DataType="single")
Sig = Simulink.Signal()
L = Simulink.Parameter(0.00535, StorageClass="Struct", StructName="motor", DataType="single")
Rs = Simulink.Parameter(6.97, StorageClass="Struct", StructName="motor", DataType="single")
flux = Simulink.Parameter(0.016884, StorageClass="Struct", StructName="motor", DataType="single")
Pn = Simulink.Parameter(4, StorageClass="Struct", StructName="motor", DataType="single")
Udc = Simulink.Parameter(24, DataType="single")
CurrKi = Simulink.Parameter(35, DataType="single")
CurrKp = Simulink.Parameter(0.17, DataType="single")
ThetaOpen = Simulink.Signal(StorageClass="ExportedGlobal", DataType="single")