% Simulink data dictionary speedloop.sldd

ia = Simulink.Signal(StorageClass="ExportedGlobal", DataType="single")
ic = Simulink.Signal(StorageClass="ExportedGlobal", DataType="single")
ib = Simulink.Signal(StorageClass="ExportedGlobal", DataType="single")
ialpha = Simulink.Signal(StorageClass="ExportedGlobal", DataType="single")
ibeta = Simulink.Signal(StorageClass="ExportedGlobal", DataType="single")
id = Simulink.Signal(StorageClass="ExportedGlobal", DataType="single")
iq = Simulink.Signal(StorageClass="ExportedGlobal", DataType="single")
Sig = Simulink.Signal()
L = Simulink.Parameter(0.00535, StorageClass="Struct", StructName="motor", DataType="single")
Rs = Simulink.Parameter(6.97, StorageClass="Struct", StructName="motor", DataType="single")
Udc = Simulink.Parameter(24, DataType="single")
CurrKi = Simulink.Parameter(35, DataType="single")
ThetaOpen = Simulink.Signal(StorageClass="ExportedGlobal", DataType="single")
spd_kp = Simulink.Parameter(0.3389, StorageClass="Struct", StructName="spd_kpki", DataType="single")
spd_ki = Simulink.Parameter(0.0144, StorageClass="Struct", StructName="spd_kpki", DataType="single")
flux = Simulink.Parameter(0.008442, StorageClass="Struct", StructName="motor", DataType="single")
Pn = Simulink.Parameter(2, StorageClass="Struct", StructName="motor", DataType="single")
CurrKp = Simulink.Parameter(0.26, DataType="single")