% Simulink data dictionary BLDC_EKF.sldd

Tpwm = Simulink.Parameter(16000, DataType="uint16")
ialpha = Simulink.Signal(StorageClass="ExportedGlobal", DataType="single")
ibeta = Simulink.Signal(StorageClass="ExportedGlobal", DataType="single")
ualpha = Simulink.Signal(StorageClass="ExportedGlobal", DataType="single")
ubeta = Simulink.Signal(StorageClass="ExportedGlobal", DataType="single")
Ts = Simulink.Parameter(0.0001, DataType="single")
Udc = Simulink.Parameter(24, DataType="single")
state = Simulink.Signal(StorageClass="ExportedGlobal", DataType="single")
spd_kp = Simulink.Parameter(0.0031514, StorageClass="Struct", StructName="spd_kpki", DataType="single")
spd_ki = Simulink.Parameter(0.0001229046, StorageClass="Struct", StructName="spd_kpki", DataType="single")
curr_d_ki = Simulink.Parameter(35, StorageClass="Struct", StructName="curr_kpki", DataType="single")
curr_d_kp = Simulink.Parameter(0.025, StorageClass="Struct", StructName="curr_kpki", DataType="single")
EKFTheta = Simulink.Signal(StorageClass="ExportedGlobal", DataType="single")
EKFWm = Simulink.Signal(StorageClass="ExportedGlobal", DataType="single")
flux = Simulink.Parameter(0.016884, DataType="single")
Rs = Simulink.Parameter(6.97, DataType="single")
L = Simulink.Parameter(0.00535, DataType="single")
Pn = Simulink.Parameter(4, DataType="single")